# Grasshopper definition LatLon.ghx (Grasshopper 1.0.7)
# plug-ins: ElkGHComponents, Caribou

file_path = FilePath("Z:\Sites\Caribou\Caribou.Tests\Cases\melbourne.xml")
location = Location(FilePathText=file_path)  # -> OSMPointData, OSMFile, LongitudeDomain, LatitudeDomain
read_file = ReadFile(File=file_path, PerLineParse=True)
openstreetmap = OpenStreetMap(OSMContent=read_file, OSMFeatures="craft")  # -> Nodes, Ways, Debug
osm_data = OSMData(OSMPointData=location.OSMPointData, OSMFilePath=file_path, Feature="craft", Generate3d=False, IndividualOutputs=False)  # -> Ways, FeatureKey
panel = Panel(osm_data.Ways)
panel_2 = Panel(openstreetmap.Nodes)
