# Grasshopper definition Melbourne.ghx (Grasshopper 1.0.7)
# plug-ins: Caribou

path = FilePath("Z:\Sites\Caribou\Caribou.Tests\Cases\melbourne.xml")
file = ReadFile(File=path, PerLineParse=True)  # disabled
panel = Panel("amenity:restaurant")
panel_2 = Panel("""amenity:restaurant
highway:residential""")
osm = OpenStreetMap(OSMContent=file)  # -> Ways, Nodes, Debug; disabled
file_2 = ReadFile(File=path, PerLineParse=False)
osm_2 = OpenStreetMap(OSMContent=file_2, OSMFeatures="waterway")  # -> Nodes, Ways, Debug
panel_3 = Panel(osm_2.Nodes)
panel_4 = Panel(osm_2.Ways)
panel_5 = Panel(osm_2.Debug)
