# Grasshopper definition Caribou - Extensions Example.ghx (Grasshopper 1.0.7)
# plug-ins: Caribou, Human

# ---- group: Define custom queries
panel = Panel("building=office")
panel_2 = Panel("building=apartments")
panel_3 = Panel("addr:street=Taranaki Street")
panel_4 = Panel("highway=traffic_signals")
panel_5 = Panel("amenity=cafe")
panel_6 = Panel("cuisine=mexican")

# ----
# NOTE!: If you want to see this example file in action, you will need to reference a downloaded Open Street Map xml file into the file path parameter to the right ->
specify_features = SpecifyFeatures(selectionIncludesObscure=True, selectionSerialised="craft=*,emergency=*,healthcare=*,highway=*,historic=*,landuse=*")  # -> OSMFeatures, Debug

# ---- group: Reference OSM example here
file_path = FilePath("Z:\Sites\Caribou\OSM Test Data\wellington-overpass-export.osm")

# ----
file_path_2 = FilePath(file_path)
text = Text(specify_features.OSMFeatures)
extract_ways = ExtractWays(OSMFilePath=file_path_2, OSMFeatures=text)  # -> Ways, Tags, Report, Bounds, Debug
filter_tags = FilterTags(Items=extract_ways.Ways, Tags=extract_ways.Tags)  # -> Items, Tags, Report, Debug
extract_nodes = ExtractNodes(OSMFilePath=file_path_2, OSMFeatures=text)  # -> Nodes, Tags, Report, Bounds, Debug
extract_buildings = ExtractBuildings(OSMFilePath=file_path_2, OSMFeatures=[panel, panel_2, panel_5])  # -> Buildings, Tags, Report, Debug, Debug_2

# ---- group: Make a key to be shown in Rhino with Per-Feature Colors and Counts
data = Data(extract_nodes.Report)
list_item = ListItem(List=data, Index="0", Wrap=True)
list_item_2 = ListItem(List=data, Index="2", Wrap=True)
text_join = TextJoin(Text=[list_item, list_item_2], Join=", ")  # -> flatten(Result)
list_item_3 = ListItem(List=data, Index="3", Wrap=True)  # -> flatten(Item)
rectangle = Rectangle({Plane=PlaneXY(3149691.735, 3877203.159, 0), Size=Domain2(u=-531927.6234..531927.6234, v=-869497.0767..869497.0767)})
legend = Legend(Colour=list_item_3, Tags=text_join, Rectangle=rectangle, LegendType=1)

# ---- group: Visualise in Grasshopper with Per-Feature Colors
data_2 = Data(extract_buildings.Buildings)
data_3 = Data(extract_buildings.Report)
list_item_4 = ListItem(List=data_3, Index="3", Wrap=True)
custom_preview = CustomPreview(Geometry=data_2, Material=list_item_4)

# ---- group: Bake all geometry into Rhino we Per-Feature Layers and Colors
bake = Button()
data_4 = Data(extract_buildings.Buildings)
data_5 = Data(extract_buildings.Report)
list_item_5 = ListItem(List=data_5, Index="3", Wrap=True)
list_item_6 = ListItem(List=data_5, Index="5", Wrap=True)
create_modify_layers = CreateModifyLayers(LayerName=list_item_6, LayerColor=list_item_5, DeleteLayer=False, enableFullPath=True)  # -> LayerNames, LayerFullPath
createattributes = CreateAttributes(LayerName=create_modify_layers.LayerFullPath, enableFullPath=True)
bake_geometry = BakeGeometry(Bake=bake, Geometry=data_4, Attributes=createattributes, DeleteOldBakes=False, PreserveTrees=False)

# ---- group: Visualise in Grasshopper with Per-Feature Colors
data_6 = Data(extract_ways.Ways)
data_7 = Data(extract_ways.Report)
list_item_7 = ListItem(List=data_7, Index="3", Wrap=True)
custom_preview_2 = CustomPreview(Geometry=data_6, Material=list_item_7)

data_8 = Data(extract_nodes.Nodes)
data_9 = Data(extract_nodes.Report)
list_item_8 = ListItem(List=data_9, Index="3", Wrap=True)
custom_preview_3 = CustomPreview(Geometry=data_8, Material=list_item_8)

# ----
geometry = Geometry(extract_ways.Ways)
data_10 = Data(extract_ways.Tags)

# ---- group: Filter geometry by tag match (e.g. find all roads tagged as oneway and as paved)
geometry_2 = Geometry(geometry)
data_11 = Data(data_10)
filter_for_exact_match = Panel("oneway=yes")
filter_for_exact_match_2 = Panel("surface=paved")
text_2 = Text([filter_for_exact_match, filter_for_exact_match_2])
match_text = MatchText(Text=graft(data_11), Pattern=text_2, Case=False)
list_length = ListLength(List=text_2)
trim_tree = TrimTree(Tree=match_text, Depth="1")
mass_addition = MassAddition(Input=trim_tree)  # -> Result, PartialResults
equality = Equality(FirstNumber=list_length, SecondNumber=mass_addition.Result)  # -> Equality, Inequality
trim_tree_2 = TrimTree(Tree=equality.Equality, Depth="1")
cull_pattern = CullPattern(List=geometry_2, CullPattern=trim_tree_2)
geometry_3 = Geometry(cull_pattern)

# ---- group: Filter geometry by tag value comparison (e.g. find all roads with a maxspeed value between X and Y)
# Explanation of the two filter panels: The first panel identifies a piece of text to find that covers all possible values. Generally this takes the form of SOMETHING=* where the "*" matches any subsequent value.
# 
# The second panel identifies a piece of text to remove so that only the value/number you want to identify is present. Most of the time this will be the same as the previous panel but without the "*"
filter_for_match = Panel("maxspeed=*")
filter_to_extract_value = Panel("maxspeed=")
upper_value_limit = Slider(48, range=0..100)
lower_value_limit = Slider(0, range=0..10)
geometry_4 = Geometry(geometry)
data_12 = Data(data_10)
match_text_2 = MatchText(Text=data_12, Pattern=filter_for_match, Case=False)
construct_domain = ConstructDomain(DomainStart=lower_value_limit, DomainEnd=upper_value_limit)
cull_pattern_2 = CullPattern(List=data_12, CullPattern=match_text_2)
replace_text = ReplaceText(Text=cull_pattern_2, Find=filter_to_extract_value, RecursiveReplace=False)
includes = Includes(Value=replace_text, Domain=construct_domain)  # -> Includes, Deviation
mass_addition_2 = MassAddition(Input=includes.Includes)  # -> Result, PartialResults
replace_nulls = ReplaceNulls(Items=mass_addition_2.Result, Replacements="0")  # -> Items, Count
larger_than = LargerThan(FirstNumber=replace_nulls.Items, SecondNumber=0)  # -> LargerThan, OrEqualTo
trim_tree_3 = TrimTree(Tree=larger_than.LargerThan, Depth="1")
cull_pattern_3 = CullPattern(List=geometry_4, CullPattern=trim_tree_3)
geometry_5 = Geometry(cull_pattern_3)
