# Grasshopper definition Caribou - Simple Example.ghx (Grasshopper 1.0.7)
# plug-ins: Caribou

specify_features = SpecifyFeatures(selectionIncludesObscure=True, selectionSerialised="craft=*,emergency=*,healthcare=*,highway=*,historic=*,landuse=*")  # -> OSMFeatures, Debug

# ---- group: Reference OSM download here
# NOTE!: If you want to see this example file in action, you will need to reference a downloaded Open Street Map xml file into the file path parameter to the right ->
path = FilePath(["Z:\Sites\Caribou\Caribou.Tests\OSMxml\singapore-left.osm", "Z:\Sites\Caribou\Caribou.Tests\OSMxml\singapore-right.osm", "Z:\Sites\Caribou\Caribou.Tests\OSMxml\singapore-top-no-overlap.osm"])

# ----
extract_nodes = ExtractNodes(OSMFilePath=path, OSMFeatures=specify_features.OSMFeatures)  # -> Nodes, Tags, Report, Bounds, Debug
extract_ways = ExtractWays(OSMFilePath=path, OSMFeatures=specify_features.OSMFeatures)  # -> Ways, Tags, Report, Bounds, Debug
extract_buildings = ExtractBuildings(OSMFilePath=path, OSMFeatures=specify_features.OSMFeatures)  # -> Buildings, Tags, Report, Bounds, Debug
panel = Panel(extract_ways.Tags)

# ---- group: Visualise in Grasshopper with Per-Feature Colors
data = Data(extract_nodes.Nodes)
data_2 = Data(extract_nodes.Report)
list_item = ListItem(List=data_2, Index="3", Wrap=True)
custom_preview = CustomPreview(Geometry=data, Material=list_item)

# ----
panel_2 = Panel(extract_ways.Report)
